vi "index.gviweb"   [G Web Development Software 22.3.0]
panel controls:
  "Fd": f64 = 5
  "Fc": f64 = 5
  "forstyrrelse Fd": bool = TRUE
  "Pause": bool
  "P-REGULATOR": bool
  "SKAL-verdi": f64 = 50
  "Kp": f64 = 0.5
  "milliseconds to wait": u32 = 250
panel indicators:
  "Trendkurver for nivå": cluster{"Element 1": f64, "Element 2": f64}
  "Tank": f64
  "Fut": f64
  "Trendkurver for prosesstrømmer": T1
  "Er verdi": f64
  "F_c": f64
  "F_d": f64
  "Poeng:": i32
  "Reguleringsavvik": f64
  "teller": i32
  "stopp": bool
types:
  T1 = cluster{"Element 1": f64, "Element 2": f64, "Element 3": f64}
diagram:
  s1 = 50  # shift register
  s2 = 0  # shift register
  s3 = 0  # shift register
  while {
    Build Cluster(s1, $"SKAL-verdi") -> w1
    $"Trendkurver for nivå" <- w1
    Subtract(x=$"SKAL-verdi", y=$"Er verdi") -> w2
    $Reguleringsavvik <- w2
    $Tank <- s1
    In Range And Coerce(lower limit=0, upper limit=10, x=$Fc) -> (coerced(x)=w3)
    Build Cluster($Fd, w3, $Fut) -> w4
    $"Trendkurver for prosesstrømmer" <- w4
    Add($Fd, w3) -> w5
    Subtract(x=w5, y=$Fut) -> w6
    Add(w6, s1) -> w7
    In Range And Coerce(lower limit=0, upper limit=100, x=w7) -> (coerced(x)=w8)
    Is Less(x=w8, y=20) -> w9
    case (w9) {
      frame False, Default { }
      frame True {
        Number To Decimal String(number=$"Poeng:") -> (decimal integer string=w10)
        Concatenate Strings("tanken er tom!", "\n", "Game over!!!!", "\n", "Du fikk  ", w10, " poeng.") -> w11
        One Button Dialog(message=w11) -> (true=w12)
        $stopp <- w12
      }
    }
    $F_d <- $Fd
    $F_c <- w3
    Is Greater(x=w8, y=80) -> w13
    case (w13) {
      frame False, Default { }
      frame True {
        Number To Decimal String(number=$"Poeng:") -> (decimal integer string=w14)
        Concatenate Strings("tanken er full!", "\n", "Game over!!!!", "\n", "Du fikk  ", w14, " poeng.") -> w15
        One Button Dialog(message=w15) -> (true=w16)
        $stopp <- w16
      }
    }
    $"Er verdi" <- w8
    Square Root(x=s1) -> w17
    Square Root(x=2) -> w18
    Multiply(w17, w18) -> w19
    $Fut <- w19
    case ($"forstyrrelse Fd") {
      frame False, Default {
        w20 = 0
      }
      frame True {
        Increment(x=s2) -> w21
        Is Greater(x=w21, y=40) -> w22
        Select(s=w22, t=0, f=w21) -> w20
        Is Less(x=s2, y=1) -> w23
        case (w23) {
          frame False, Default { }
          frame True {
            Random Number() -> (number (0 to 1)=w24)
            Multiply(w24, 10) -> w25
            $Fd <- w25
          }
        }
      }
    }
    case ($Pause) {
      frame False, Default { }
      frame True {
        while {
          Not(x=$Pause) -> w26
          stop if w26
        }
      }
    }
    case ($"P-REGULATOR") {
      frame False, Default { }
      frame True {
        Subtract(x=$"SKAL-verdi", y=$"Er verdi") -> w27
        Multiply(w27, $Kp) -> w28
        $Fc <- w28
      }
    }
    Add(s3, 1) -> w29
    Absolute Value(x=$Reguleringsavvik) -> w30
    Is Greater(x=w30, y=20) -> w31
    case (w31) {
      frame False, Default {
        w32 = w29
      }
      frame True {
        Subtract(x=w29, y=50) -> w32
      }
    }
    $"Poeng:" <- s3
    Logical Or($stopp, FALSE) -> w33
    Wait(time to wait=$"milliseconds to wait")
    Multiply(50, $teller) -> w34
    Is Greater(x=$"Poeng:", y=w34) -> w35
    case (w35) {
      frame False, Default { }
      frame True {
        Increment(x=$teller) -> w36
        $teller <- w36
        Subtract(x=$"milliseconds to wait", y=50) -> w37
        Is Less(x=w37, y=50) -> w38
        Select(s=w38, t=50, f=w37) -> w39
        $"milliseconds to wait" <- w39
      }
    }
    next s1 = w8
    next s2 = w20
    next s3 = w32
    stop if w33
  }
  $teller <- 1
  $"milliseconds to wait" <- 250
